# Dynamo custom node GenericAnnotation.PointInView.dyf (Dynamo 1.0.0.1180)
# category: Parametrix
# Place Generic Annotation at Point In View

points = Input()
familyType = Input()
view = Input()
python_script = Python(IN[0]=points, IN[1]=familyType, IN[2]=view)
# ---------- python_script.python (37 lines) ----------
import clr
clr.AddReference('ProtoGeometry')
from Autodesk.DesignScript.Geometry import *

clr.AddReference('RevitAPI')
from Autodesk.Revit.DB import *

clr.AddReference("RevitNodes")
import Revit
clr.ImportExtensions(Revit.Elements)
clr.ImportExtensions(Revit.GeometryConversion)

clr.AddReference("RevitServices")
import RevitServices
from RevitServices.Persistence import DocumentManager
from RevitServices.Transactions import TransactionManager

#The inputs to this node will be stored as a list in the IN variables.
dataEnteringNode = IN

doc = DocumentManager.Instance.CurrentDBDocument
points = UnwrapElement(IN[0])
famtype = UnwrapElement(IN[1])
view = UnwrapElement(IN[2])

elementList = list()


TransactionManager.Instance.EnsureInTransaction(doc)
for point in points:
	newInst = doc.Create.NewFamilyInstance(point.ToXyz(), famtype, view)
	elementList.append(newInst.ToDSType(False))
TransactionManager.Instance.TransactionTaskDone()


#Assign your output to the OUT variable.
OUT = elementList
# ----------------------------------------
FamilyInstance = Output(python_script)
