# Dynamo custom node GenericAnnotation.PointsInViews.dyf (Dynamo 1.0.0.1180)
# category: Parametrix
# Place Generic Annotation at Point In View

pointList = Input()
remove_z_component_to_place_in = CodeBlock(inputPoint=pointList) { inputPoint; Point.ByCoordinates(inputPoint.X, inputPoint.Y,0); }  # "Remove 'Z' Component To Place in Views"
familyType = Input()
viewList = Input()
python_script = Python(IN[0]=remove_z_component_to_place_in.out1, IN[1]=familyType, IN[2]=viewList)
# ---------- python_script.python (41 lines) ----------
import clr
clr.AddReference('ProtoGeometry')
from Autodesk.DesignScript.Geometry import *

clr.AddReference('RevitAPI')
from Autodesk.Revit.DB import *

clr.AddReference("RevitNodes")
import Revit
clr.ImportExtensions(Revit.Elements)
clr.ImportExtensions(Revit.GeometryConversion)

clr.AddReference("RevitServices")
import RevitServices
from RevitServices.Persistence import DocumentManager
from RevitServices.Transactions import TransactionManager

#The inputs to this node will be stored as a list in the IN variables.
dataEnteringNode = IN

doc = DocumentManager.Instance.CurrentDBDocument
points = UnwrapElement(IN[0])
famtype = UnwrapElement(IN[1])
views = UnwrapElement(IN[2])

elementList = list()
counter = 0;

TransactionManager.Instance.EnsureInTransaction(doc)
for point in points:
	#get corresponding view
	view = views[counter]
	
	newInst = doc.Create.NewFamilyInstance(point.ToXyz(), famtype, view)
	elementList.append(newInst.ToDSType(False))
	counter+=1
TransactionManager.Instance.TransactionTaskDone()


#Assign your output to the OUT variable.
OUT = elementList
# ----------------------------------------
FamilyInstance = Output(python_script)
