# Dynamo custom node List.FilterByParameterValue.dyf (Dynamo 1.0.0.1180)
# category: Parametrix
# Filters a List based on a given Parameter Value

Element = Input()
parameterNameToFilter = Input()
getParameterValueByName = Element.GetParameterValueByName(element=Element, parameterName=parameterNameToFilter)
parameterValueToFilter = Input()
eq = getParameterValueByName == parameterValueToFilter
filterByBoolMask = List.FilterByBoolMask(list=Element, mask=eq)
Element_2 = Output(filterByBoolMask.in)  # "Element"
