# Dynamo custom node Save Model Group Names+Count.dyf (Dynamo 0.9.2.4472)
# category: Parametrix
# Extracts Model Group Metrics

FilePath = Input()
getModelGroups = Python()
# ---------- getModelGroups.python (27 lines) ----------
import clr
clr.AddReference("ProtoGeometry")
from Autodesk.DesignScript.Geometry import *

# Import DocumentManager and TransactionManager
clr.AddReference("RevitServices")
import RevitServices
from RevitServices.Persistence import DocumentManager
from RevitServices.Transactions import TransactionManager

# Import RevitAPI
clr.AddReference("RevitAPI")
import Autodesk
from Autodesk.Revit.DB import *

doc = DocumentManager.Instance.CurrentDBDocument
uiapp = DocumentManager.Instance.CurrentUIApplication
app = uiapp.Application

from System.Collections.Generic import *

#The inputs to this node will be stored as a list in the IN variable.
dataEnteringNode = IN

collector = FilteredElementCollector(doc)
groups = collector.OfCategory(BuiltInCategory.OST_IOSModelGroups).WhereElementIsNotElementType().ToElements()
OUT = groups
# ----------------------------------------
getGroupName_Count = Custom[GetGroupName+Count](Element=getModelGroups)  # Gets Group Names and Counts
writeToFile = CSV.WriteToFile(FilePath, getGroupName_Count)
